# Dynamo custom node CompasMesh.Edges.dyf (Dynamo 1.3.0.875)
# category: Compas.Datastructures.Mesh
# Return the edges of the compas mesh as Dynamo lines.

CompasMesh = Input()
edges = Python(IN[0]=CompasMesh)  # "CompasMesh.Edges"
# ---------- edges.python (29 lines) ----------
import sys

with open('C:/Temp/compas_path.txt', 'r') as f:
    compas_path = f.readline().strip()
    iron_path = f.readline().strip()

sys.path.insert(0, iron_path)
sys.path.insert(0, iron_path + 'DLLs')
sys.path.insert(0, iron_path + 'Lib')
sys.path.insert(0, compas_path)

import clr
clr.AddReference('ProtoGeometry')
from Autodesk.DesignScript.Geometry import *

import compas
from compas.datastructures.mesh import Mesh

mesh = IN[0]

key_index = mesh.key_index()

vertices = [mesh.vertex_coordinates(key) for key in mesh.vertices()]
points = [Point.ByCoordinates(x, y, z) for x, y, z in vertices]

edges = [(key_index[u], key_index[v]) for u, v in mesh.edges()]
lines = [Line.ByStartPointEndPoint(points[i], points[j]) for i, j in edges]

OUT = lines
# ----------------------------------------
Line = Output(edges)  # "Line[]"
