# Dynamo custom node CompasMesh.VertexKeys.dyf (Dynamo 1.3.0.875)
# category: Compas.Datastructures.Mesh
# Return the keys of the vertices of a compas mesh as a list.

CompasMesh = Input()
vertexKeys = Python(IN[0]=CompasMesh)  # "CompasMesh.VertexKeys"
# ---------- vertexKeys.python (20 lines) ----------
import sys

with open('C:/Temp/compas_path.txt', 'r') as f:
    compas_path = f.readline().strip()
    iron_path = f.readline().strip()

sys.path.insert(0, iron_path)
sys.path.insert(0, iron_path + 'DLLs')
sys.path.insert(0, iron_path + 'Lib')
sys.path.insert(0, compas_path)

import clr
clr.AddReference('ProtoGeometry')
from Autodesk.DesignScript.Geometry import *

import compas

mesh = IN[0]

OUT = list(mesh.vertices())
# ----------------------------------------
List = Output(vertexKeys)
