# Dynamo custom node CompasMesh.from_obj.dyf (Dynamo 1.3.0.875)
# category: Compas.Datastructures.Mesh
# Construct a compas mesh from an OBJ file.

FilePath = Input()
meshFromOBJ = Python(IN[0]=FilePath)
# ---------- meshFromOBJ.python (23 lines) ----------
import sys

with open('C:/Temp/compas_path.txt', 'r') as f:
    compas_path = f.readline().strip()
    iron_path = f.readline().strip()

sys.path.insert(0, iron_path)
sys.path.insert(0, iron_path + 'DLLs')
sys.path.insert(0, iron_path + 'Lib')
sys.path.insert(0, compas_path)

import clr
clr.AddReference('ProtoGeometry')
from Autodesk.DesignScript.Geometry import *

import compas
from compas.datastructures.mesh import Mesh

filepath = IN[0]

mesh = Mesh.from_obj(filepath)

OUT = mesh
# ----------------------------------------
CompasMesh = Output(meshFromOBJ)
