# Dynamo custom node CompasMesh.from_polyhedron.dyf (Dynamo 1.3.0.875)
# category: Compas.Datastructures.Mesh
# Create a compas mesh from a platonic solid.

number_of_faces = Input()
scale = Input()
python_script = Python(IN[0]=number_of_faces, IN[1]=scale)
# ---------- python_script.python (31 lines) ----------
import sys

with open('C:/Temp/compas_path.txt', 'r') as f:
    compas_path = f.readline().strip()
    iron_path = f.readline().strip()

sys.path.insert(0, iron_path)
sys.path.insert(0, iron_path + 'DLLs')
sys.path.insert(0, iron_path + 'Lib')
sys.path.insert(0, compas_path)

import clr
clr.AddReference('ProtoGeometry')
from Autodesk.DesignScript.Geometry import *

import compas
from compas.datastructures.mesh import Mesh
from compas.geometry.elements import Polyhedron
from compas.datastructures.mesh.algorithms import scale_mesh

number_of_faces = IN[0]
scale = IN[1]

if number_of_faces in (4, 6, 8, 10, 12):
	polyhedron = Polyhedron.generate(number_of_faces)
	mesh = Mesh.from_vertices_and_faces(polyhedron.vertices, polyhedron.faces)
	scale_mesh(mesh, scale)
else:
	mesh = None

OUT = mesh
# ----------------------------------------
CompasMesh = Output(python_script)
