# Dynamo custom node CompasMesh.smooth_mesh_centroid.dyf (Dynamo 1.3.0.875)
# category: Compas.Datastructures.Mesh
# Smooth a compas mesh using the "smooth_mesh_centroid" algorithm.

CompasMesh = Input()
fixed = Input()
meshSmoothCentroid = Python(IN[0]=CompasMesh, IN[1]=fixed)
# ---------- meshSmoothCentroid.python (30 lines) ----------
import sys

with open('C:/Temp/compas_path.txt', 'r') as f:
    compas_path = f.readline().strip()
    iron_path = f.readline().strip()

sys.path.insert(0, iron_path)
sys.path.insert(0, iron_path + 'DLLs')
sys.path.insert(0, iron_path + 'Lib')
sys.path.insert(0, compas_path)

import clr
clr.AddReference('ProtoGeometry')
from Autodesk.DesignScript.Geometry import *

import compas
from compas.datastructures.mesh import Mesh
from compas.datastructures.mesh.algorithms import smooth_mesh_centroid

mesh = IN[0]
fixed = IN[1]

smooth = mesh.copy()

if not fixed:
    fixed = mesh.vertices_on_boundary()

smooth_mesh_centroid(smooth, fixed=fixed, kmax=100)

OUT = smooth
# ----------------------------------------
CompasMesh_2 = Output(meshSmoothCentroid)  # "CompasMesh"
