# Dynamo custom node CompasMesh.subdivide_mesh_catmullclark.dyf (Dynamo 1.3.0.875)
# category: Compas.Datastructures.Mesh
# Subdivide a compas mesh according to the catmull-clark scheme.

CompasMesh = Input()
k = Input()
fixed = Input()
subdivide_mesh_catmullclark = Python(IN[0]=CompasMesh, IN[1]=k, IN[2]=fixed)  # "CompasMesh.subdivide_mesh_catmullclark"
# ---------- subdivide_mesh_catmullclark.python (29 lines) ----------
import sys

with open('C:/Temp/compas_path.txt', 'r') as f:
    compas_path = f.readline().strip()
    iron_path = f.readline().strip()

sys.path.insert(0, iron_path)
sys.path.insert(0, iron_path + 'DLLs')
sys.path.insert(0, iron_path + 'Lib')
sys.path.insert(0, compas_path)

import clr
clr.AddReference('ProtoGeometry')
from Autodesk.DesignScript.Geometry import *

import compas
from compas.datastructures.mesh import Mesh
from compas.datastructures.mesh.algorithms import subdivide_mesh_catmullclark

mesh = IN[0]
k = IN[1]
fixed = IN[2]

if not fixed:
    fixed = []

subd = subdivide_mesh_catmullclark(mesh, k=k, fixed=fixed)

OUT = subd
# ----------------------------------------
CompasMesh_2 = Output(subdivide_mesh_catmullclark)  # "CompasMesh"
