# Dynamo custom node CompasNetwork.HighlightVertex.dyf (Dynamo 1.3.0.875)
# category: Compas.Datastructures.Network
# Highlight a vertex of a compas network

CompasNetwork = Input()
index = Input()
highlightVertex = Python(IN[0]=CompasNetwork, IN[1]=index)  # "CompasNetwork.HighlightVertex"
# ---------- highlightVertex.python (26 lines) ----------
import sys

with open('C:/Temp/compas_path.txt', 'r') as f:
    compas_path = f.readline().strip()
    iron_path = f.readline().strip()

sys.path.insert(0, iron_path)
sys.path.insert(0, iron_path + 'DLLs')
sys.path.insert(0, iron_path + 'Lib')
sys.path.insert(0, compas_path)

import clr
clr.AddReference('ProtoGeometry')
from Autodesk.DesignScript.Geometry import *

import compas
from compas.datastructures.network.algorithms import network_dijkstra_path

network = IN[0]
index = IN[1]

vertices = [network.vertex_coordinates(key) for key in network.vertices()]
x, y, z = vertices[index]
point = Point.ByCoordinates(x, y, z)

OUT = point
# ----------------------------------------
Point = Output(highlightVertex)
