# Dynamo custom node CompasNetwork.from_obj.dyf (Dynamo 1.3.0.875)
# category: Compas.Datastructures.Network
# Make a compas network from an OBJ file.

FilePath = Input()
from_obj = Python(IN[0]=FilePath)  # "CompasNetwork.from_obj"
# ---------- from_obj.python (23 lines) ----------
import sys

with open('C:/Temp/compas_path.txt', 'r') as f:
    compas_path = f.readline().strip()
    iron_path = f.readline().strip()

sys.path.insert(0, iron_path)
sys.path.insert(0, iron_path + 'DLLs')
sys.path.insert(0, iron_path + 'Lib')
sys.path.insert(0, compas_path)

import clr
clr.AddReference('ProtoGeometry')
from Autodesk.DesignScript.Geometry import *

import compas
from compas.datastructures.network import Network

filepath = IN[0]

network = Network.from_obj(filepath)

OUT = network
# ----------------------------------------
CompasNetwork = Output(from_obj)
