# Dynamo custom node CompasNetwork.network_dijkstra_path.dyf (Dynamo 1.3.0.875)
# category: Compas.Datastructures.Network
# Compute the shortest path between two vertices of a compas network with weighted edges.

CompasNetwork = Input()
start = Input()
end = Input()
weight = Input(weight:var=null)
network_dijkstra_path = Python(IN[0]=CompasNetwork, IN[1]=start, IN[2]=end, IN[3]=weight)  # "CompasNetwork.network_dijkstra_path"
# ---------- network_dijkstra_path.python (50 lines) ----------
import sys

with open('C:/Temp/compas_path.txt', 'r') as f:
    compas_path = f.readline().strip()
    iron_path = f.readline().strip()

sys.path.insert(0, iron_path)
sys.path.insert(0, iron_path + 'DLLs')
sys.path.insert(0, iron_path + 'Lib')
sys.path.insert(0, compas_path)

import clr
clr.AddReference('ProtoGeometry')
from Autodesk.DesignScript.Geometry import *

import compas
from compas.datastructures.network.algorithms import network_dijkstra_path

network = IN[0]
start = IN[1]
end = IN[2]

points = []
lines = []

if start is not None and end is not None:
	if start in network.vertex and end in network.vertex:
		weight = {(u, v): network.edge_length(u, v) for index, (u, v) in enumerate(network.edges())}
		weight.update({(v, u): weight[(u, v)] for u, v in network.edges()})
		
		path = network_dijkstra_path(network.adjacency, weight, start, end)
		
		edges = []
		
		for i in range(len(path) - 1):
		    u = path[i]
		    v = path[i + 1]
		    if v not in network.edge[u]:
		        u, v = v, u
		    edges.append([u, v])
		    
		key_index = {key: index for index, key in enumerate(path)}
		    
		path  = [network.vertex_coordinates(key) for key in path]
		edges = [(key_index[u], key_index[v]) for u, v in edges]
		
		points = [Point.ByCoordinates(x, y, z) for x, y, z in path]
		lines  = [Line.ByStartPointEndPoint(points[i], points[j]) for i, j in edges]

OUT = points, lines
# ----------------------------------------
python_script = Python(IN[0]=network_dijkstra_path)
# ---------- python_script.python (10 lines) ----------
import clr
clr.AddReference('ProtoGeometry')
from Autodesk.DesignScript.Geometry import *
#The inputs to this node will be stored as a list in the IN variables.
dataEnteringNode = IN

points, lines = IN[0]

#Assign your output to the OUT variable.
OUT = points
# ----------------------------------------
Points = Output(python_script)
python_script_2 = Python(IN[0]=network_dijkstra_path)
# ---------- python_script_2.python (10 lines) ----------
import clr
clr.AddReference('ProtoGeometry')
from Autodesk.DesignScript.Geometry import *
#The inputs to this node will be stored as a list in the IN variables.
dataEnteringNode = IN

points, lines = IN[0]

#Assign your output to the OUT variable.
OUT = lines
# ----------------------------------------
Lines = Output(python_script_2)
