# Dynamo custom node CompasNetwork.smooth_network_centroid.dyf (Dynamo 1.3.0.875)
# category: Compas.Datastructures.Network
# Smooth the network by moving every vertex to the centroid of its neighbours.

CompasNetwork = Input()
fixed = Input()
kmax = Input()
smooth_network_centroid = Python(IN[0]=CompasNetwork, IN[1]=fixed, IN[2]=kmax)  # "CompasNetwork.smooth_network_centroid"
# ---------- smooth_network_centroid.python (30 lines) ----------
import sys

with open('C:/Temp/compas_path.txt', 'r') as f:
    compas_path = f.readline().strip()
    iron_path = f.readline().strip()

sys.path.insert(0, iron_path)
sys.path.insert(0, iron_path + 'DLLs')
sys.path.insert(0, iron_path + 'Lib')
sys.path.insert(0, compas_path)

import clr
clr.AddReference('ProtoGeometry')
from Autodesk.DesignScript.Geometry import *

import compas
from compas.datastructures.network.algorithms import smooth_network_centroid

network = IN[0]
fixed = IN[1]
kmax = IN[2]

smooth = network.copy()

if not fixed:
    fixed = network.leaves()

smooth_network_centroid(smooth, fixed=fixed, kmax=kmax)

OUT = smooth
# ----------------------------------------
CompasNetwork_2 = Output(smooth_network_centroid)  # "CompasNetwork"
