# Dynamo custom node CompasNetwork.update_default_vertex_attributes.dyf (Dynamo 1.3.0.875)
# category: Compas.Datastructures.Network
# updates the default vertext attributes from a list of keys and a list of values

CompasNetwork = Input()
Names = Input()
Values = Input()
update_default_vertex_attributes = Python(IN[0]=CompasNetwork, IN[1]=Names, IN[2]=Values)  # "CompasNetwork.update_default_vertex_attributes"
# ---------- update_default_vertex_attributes.python (22 lines) ----------
import sys
with open('C:/Temp/compas_path.txt', 'r') as f:
    compas_path = f.readline().strip()
    iron_path = f.readline().strip()

sys.path.insert(0, iron_path)
sys.path.insert(0, iron_path+'DLLs')
sys.path.insert(0, iron_path+'Lib')
sys.path.insert(0, compas_path)

import clr
clr.AddReference('ProtoGeometry')
from Autodesk.DesignScript.Geometry import *
import compas
from compas.datastructures.network import Network

network = IN[0]
keys = IN[1]
values = IN[2]
att_dict = dict(zip(keys, values))
network.update_default_vertex_attributes(att_dict)
OUT = network
# ----------------------------------------
CompasNetwork_2 = Output(update_default_vertex_attributes)  # "CompasNetwork"
