# Dynamo custom node CompasNetwork.update_vertex_attributes.dyf (Dynamo 1.3.0.875)
# category: Compas.Datastructures.Network
# Updates vertex attributes fort a given set of points

CompasNetwork = Input()
Points = Input()
name = Input()
values = Input()
update_vertex_attributes = Python(IN[0]=CompasNetwork, IN[1]=Points, IN[2]=name, IN[3]=values)  # "CompasNetwork.update_vertex_attributes"
# ---------- update_vertex_attributes.python (42 lines) ----------
import sys
with open('C:/Temp/compas_path.txt', 'r') as f:
    compas_path = f.readline().strip()
    iron_path = f.readline().strip()

sys.path.insert(0, iron_path)
sys.path.insert(0, iron_path+'DLLs')
sys.path.insert(0, iron_path+'Lib')
sys.path.insert(0, compas_path)

import clr
clr.AddReference('ProtoGeometry')
from Autodesk.DesignScript.Geometry import *
import compas
from compas.datastructures.network import Network
from compas.utilities import geometric_key

def make_gkdict(network, precision='3f'):
    gkdict = {}
    for key in network.vertex:
        xyz = network.get_vertex_attributes(key, ['x', 'y', 'z'])
        gk = geometric_key(xyz=xyz, precision=precision)
        gkdict[gk] = key
    return gkdict

def update_network_vertex_attributes(network, points, name, values):
    gkdict = make_gkdict(network, precision='3f')
    if len(values) == 1:
        values = [values[0]] * len(points)
    for i, point in enumerate(points):
    	point = [point.X, point.Y, point.Z]
        value = values[i]
        u = gkdict[geometric_key(point, precision='3f')]
        network.set_vertex_attribute(u, name, value)

network = IN[0].copy()
points = IN[1]
name = IN[2]
values = [IN[3]]

update_network_vertex_attributes(network, points, name, values)
OUT = network
# ----------------------------------------
CompasNetwork_2 = Output(update_vertex_attributes)  # "CompasNetwork"
