# Dynamo custom node Mesh.ByCompasMesh.dyf (Dynamo 1.3.0.875)
# category: Compas.Datastructures.Mesh
# Make a dynamo mesh from a compas mesh

CompasMesh = Input()
meshToVertices = Python(IN[0]=CompasMesh)
# ---------- meshToVertices.python (25 lines) ----------
import sys

with open('C:/Temp/compas_path.txt', 'r') as f:
    compas_path = f.readline().strip()
    iron_path = f.readline().strip()

sys.path.insert(0, iron_path)
sys.path.insert(0, iron_path + 'DLLs')
sys.path.insert(0, iron_path + 'Lib')
sys.path.insert(0, compas_path)

import clr
clr.AddReference('ProtoGeometry')
from Autodesk.DesignScript.Geometry import *

import compas
from compas.datastructures.mesh import Mesh

mesh = IN[0]

xyz = [mesh.vertex_coordinates(key) for key in mesh.vertices()]

points = [Point.ByCoordinates(x, y, z) for x, y, z in xyz]

OUT = points
# ----------------------------------------
meshToFaces = Python(IN[0]=CompasMesh)
# ---------- meshToFaces.python (27 lines) ----------
import sys

with open('C:/Temp/compas_path.txt', 'r') as f:
    compas_path = f.readline().strip()
    iron_path = f.readline().strip()

sys.path.insert(0, iron_path)
sys.path.insert(0, iron_path + 'DLLs')
sys.path.insert(0, iron_path + 'Lib')
sys.path.insert(0, compas_path)

import clr
clr.AddReference('ProtoGeometry')
from Autodesk.DesignScript.Geometry import *

import compas
from compas.datastructures.mesh import Mesh

mesh = IN[0]

key_index = mesh.key_index()

faces = [mesh.face_vertices(fkey) for fkey in mesh.faces()]
faces = [[key_index[key] for key in face] for face in faces]
faces = [IndexGroup.ByIndices(*face) for face in faces]

OUT = faces
# ----------------------------------------
byPointsFaceIndices = Mesh.ByPointsFaceIndices(meshToVertices, meshToFaces)
Mesh = Output(byPointsFaceIndices)
