# Dynamo graph example_mesh-from-points.dyn (Dynamo 1.3.0.875)

code_block = CodeBlock { 0; 300; 50; }
pointcloud_2D = Custom[Compas.Pointcloud_2D](xmin=code_block.out0, xmax=code_block.out1, n=code_block.out2)  # Create a 2D pointcloud.
from_points = Custom[CompasMesh.from_points](Point=pointcloud_2D)  # Create a compas mesh from a delaynay triangulation of a set of points.
boundaryVertices = Custom[CompasMesh.BoundaryVertices](CompasMesh=from_points)  # Return the list of boundary vertices of a compas mesh.
smooth_mesh_centroid = Custom[CompasMesh.smooth_mesh_centroid](CompasMesh=from_points, fixed=boundaryVertices)  # Smooth a compas mesh using the "smooth_mesh_centroid" algorithm.
byCompasMesh = Custom[Mesh.ByCompasMesh](CompasMesh=smooth_mesh_centroid)  # Make a dynamo mesh from a compas mesh
edges = Custom[CompasMesh.Edges](CompasMesh=smooth_mesh_centroid)  # Return the edges of the compas mesh as Dynamo lines.
