# Dynamo graph example_mesh-subd-with-fixed.dyn (Dynamo 1.3.0.875)

code_block = CodeBlock { 6; 5; }
from_polyhedron = Custom[CompasMesh.from_polyhedron](number_of_faces=code_block.out0, scale=code_block.out1)  # Create a compas mesh from a platonic solid.
code_block_2 = CodeBlock { 4; }
vertexKeys = Custom[CompasMesh.VertexKeys](CompasMesh=from_polyhedron)  # Return the keys of the vertices of a compas mesh as a list.
subdivide_mesh_catmullclark = Custom[CompasMesh.subdivide_mesh_catmullclark](CompasMesh=from_polyhedron, k=code_block_2, fixed=vertexKeys)  # Subdivide a compas mesh according to the catmull-clark scheme.
byCompasMesh = Custom[Mesh.ByCompasMesh](CompasMesh=subdivide_mesh_catmullclark)  # Make a dynamo mesh from a compas mesh
vertexPositions = Custom[CompasMesh.VertexPositions](CompasMesh=subdivide_mesh_catmullclark)  # Return the vertex positions of the compas mesh as a list of Dynamo points.
edges = Custom[CompasMesh.Edges](CompasMesh=subdivide_mesh_catmullclark)  # Return the edges of the compas mesh as Dynamo lines.
info = Custom[CompasMesh.Info](CompasMesh=subdivide_mesh_catmullclark)  # Return general information about a compas mesh.
watch = Watch(info)
