# Dynamo graph example_mesh-visualisation.dyn (Dynamo 1.3.0.875)

file_path = Filename("Z:\compas\core\data\faces.obj")
from_obj = Custom[CompasMesh.from_obj](FilePath=file_path)  # Construct a compas mesh from an OBJ file.
smooth_mesh_centroid = Custom[CompasMesh.smooth_mesh_centroid](CompasMesh=from_obj)  # Smooth a compas mesh using the "smooth_mesh_centroid" algorithm.
byCompasMesh = Custom[Mesh.ByCompasMesh](CompasMesh=smooth_mesh_centroid)  # Make a dynamo mesh from a compas mesh
edges = Custom[CompasMesh.Edges](CompasMesh=smooth_mesh_centroid)  # Return the edges of the compas mesh as Dynamo lines.
vertexPositions = Custom[CompasMesh.VertexPositions](CompasMesh=smooth_mesh_centroid)  # Return the vertex positions of the compas mesh as a list of Dynamo points.
