# Dynamo graph example_network_from_obj.dyn (Dynamo 1.3.0.875)

file_path = Filename("Z:\compas\core\data\grid_irregular.obj")
from_obj = Custom[CompasNetwork.from_obj](FilePath=file_path)  # Make a compas network from an OBJ file.
edges = Custom[CompasNetwork.Edges](CompasNetwork=from_obj)  # Return the edges of a compas network as a list of Dynamo lines.
vertexPositions = Custom[CompasNetwork.VertexPositions](CompasNetwork=from_obj)  # Return the vertices of a network as a list of Dynamo points.
