# Dynamo graph example_network-dijkstra-path.dyn (Dynamo 1.3.0.875)

file_path = Filename("Z:\compas\core\data\grid_irregular.obj")
from_obj = Custom[CompasNetwork.from_obj](FilePath=file_path)  # Make a compas network from an OBJ file.
edges = Custom[CompasNetwork.Edges](CompasNetwork=from_obj)  # Return the edges of a compas network as a list of Dynamo lines.
vertexPositions = Custom[CompasNetwork.VertexPositions](CompasNetwork=from_obj)  # Return the vertices of a network as a list of Dynamo points.
integer_slider = IntegerSlider(16, range=0..100 step 1)
getItemAtIndex = List.GetItemAtIndex(list=vertexPositions, index=integer_slider)
integer_slider_2 = IntegerSlider(12, range=0..100 step 1)
getItemAtIndex_2 = List.GetItemAtIndex(list=vertexPositions, index=integer_slider_2)
network_dijkstra_path = Custom[CompasNetwork.network_dijkstra_path](CompasNetwork=from_obj, start=integer_slider, end=integer_slider_2)  # Compute the shortest path between two vertices of a compas network with weighted edges.
