# Dynamo custom node Compas.Pointcloud_2D.dyf (Dynamo 1.3.0.875)
# category: Compas
# Create a 2D pointcloud.

xmin = Input()
xmax = Input()
n = Input()
pointcloud_2D = Python(IN[0]=xmin, IN[1]=xmax, IN[2]=n)  # "Compas.Pointcloud_2D"
# ---------- pointcloud_2D.python (28 lines) ----------
import sys

with open('C:/Temp/compas_path.txt', 'r') as f:
    compas_path = f.readline().strip()
    iron_path = f.readline().strip()

sys.path.insert(0, iron_path)
sys.path.insert(0, iron_path + 'DLLs')
sys.path.insert(0, iron_path + 'Lib')
sys.path.insert(0, compas_path)

import clr
clr.AddReference('ProtoGeometry')
from Autodesk.DesignScript.Geometry import *

import compas
from compas.geometry import pointcloud_2d

xmin = IN[0]
xmax = IN[1]

n = IN[2]

cloud = pointcloud_2d(n, (xmin, xmax))

points = [Point.ByCoordinates(x, y, z) for x, y, z in cloud]

OUT = points
# ----------------------------------------
Point = Output(pointcloud_2D)  # "Point[]"
