# Dynamo custom node CompasMesh.BoundaryVertices.dyf (Dynamo 1.3.0.875)
# category: Compas.Datastructures.Mesh
# Return the list of boundary vertices of a compas mesh.

CompasMesh = Input()
boundaryVertices = Python(IN[0]=CompasMesh)  # "CompasMesh.BoundaryVertices"
# ---------- boundaryVertices.python (22 lines) ----------
import sys

with open('C:/Temp/compas_path.txt', 'r') as f:
    compas_path = f.readline().strip()
    iron_path = f.readline().strip()

sys.path.insert(0, iron_path)
sys.path.insert(0, iron_path + 'DLLs')
sys.path.insert(0, iron_path + 'Lib')
sys.path.insert(0, compas_path)

import clr
clr.AddReference('ProtoGeometry')
from Autodesk.DesignScript.Geometry import *

import compas

mesh = IN[0]

keys = mesh.vertices_on_boundary()

OUT = keys
# ----------------------------------------
List = Output(boundaryVertices)
