# Dynamo custom node CompasMesh.VertexPositions.dyf (Dynamo 1.3.0.875)
# category: Compas.Datastructures.Mesh
# Return the vertex positions of the compas mesh as a list of Dynamo points.

CompasMesh = Input()
vertexPositions = Python(IN[0]=CompasMesh)  # "CompasMesh.VertexPositions"
# ---------- vertexPositions.python (26 lines) ----------
import sys

with open('C:/Temp/compas_path.txt', 'r') as f:
    compas_path = f.readline().strip()
    iron_path = f.readline().strip()

sys.path.insert(0, iron_path)
sys.path.insert(0, iron_path + 'DLLs')
sys.path.insert(0, iron_path + 'Lib')
sys.path.insert(0, compas_path)

import clr
clr.AddReference('ProtoGeometry')
from Autodesk.DesignScript.Geometry import *

import compas
from compas.datastructures.mesh import Mesh

mesh = IN[0]

key_index = mesh.key_index()

vertices = [mesh.vertex_coordinates(key) for key in mesh.vertices()]
points = [Point.ByCoordinates(x, y, z) for x, y, z in vertices]

OUT = points
# ----------------------------------------
Point = Output(vertexPositions)  # "Point[]"
