# Dynamo custom node CompasMesh.from_points.dyf (Dynamo 1.3.0.875)
# category: Compas.Datastructures.Mesh
# Create a compas mesh from a delaynay triangulation of a set of points.

Point = Input()  # "Point[]"
from_points = Python(IN[0]=Point)  # "CompasMesh.from_points"
# ---------- from_points.python (27 lines) ----------
import sys

with open('C:/Temp/compas_path.txt', 'r') as f:
    compas_path = f.readline().strip()
    iron_path = f.readline().strip()

sys.path.insert(0, iron_path)
sys.path.insert(0, iron_path + 'DLLs')
sys.path.insert(0, iron_path + 'Lib')
sys.path.insert(0, compas_path)

import clr
clr.AddReference('ProtoGeometry')
from Autodesk.DesignScript.Geometry import *

import compas
from compas.datastructures.mesh import Mesh
from compas.datastructures.mesh.algorithms import delaunay_from_points

points = IN[0]
vertices = [[point.X, point.Y, point.Z] for point in points]

faces = delaunay_from_points(vertices)

mesh = Mesh.from_vertices_and_faces(vertices, faces)

OUT = mesh
# ----------------------------------------
CompasMesh = Output(from_points)
