# Dynamo custom node CompasNetwork.VertexKeys.dyf (Dynamo 1.3.0.875)
# category: Compas.Datastructures.Network
# Return a list of vertex keys.

CompasNetwork = Input()
vertexKeys = Python(IN[0]=CompasNetwork)  # "CompasNetwork.VertexKeys"
# ---------- vertexKeys.python (21 lines) ----------
import sys

with open('C:/Temp/compas_path.txt', 'r') as f:
    compas_path = f.readline().strip()
    iron_path = f.readline().strip()

sys.path.insert(0, iron_path)
sys.path.insert(0, iron_path + 'DLLs')
sys.path.insert(0, iron_path + 'Lib')
sys.path.insert(0, compas_path)

import clr
clr.AddReference('ProtoGeometry')
from Autodesk.DesignScript.Geometry import *

import compas
from compas.datastructures.network import Network

network = IN[0]

OUT = list(network.vertices())
# ----------------------------------------
List = Output(vertexKeys)
