# Dynamo custom node CompasNetwork.VertexPositions.dyf (Dynamo 1.3.0.875)
# category: Compas.Datastructures.Network
# Return the vertices of a network as a list of Dynamo points.

CompasNetwork = Input()
vertexPositions = Python(IN[0]=CompasNetwork)  # "CompasNetwork.VertexPositions"
# ---------- vertexPositions.python (26 lines) ----------
import sys

with open('C:/Temp/compas_path.txt', 'r') as f:
    compas_path = f.readline().strip()
    iron_path = f.readline().strip()

sys.path.insert(0, iron_path)
sys.path.insert(0, iron_path + 'DLLs')
sys.path.insert(0, iron_path + 'Lib')
sys.path.insert(0, compas_path)

import clr
clr.AddReference('ProtoGeometry')
from Autodesk.DesignScript.Geometry import *

import compas
from compas.datastructures.network import Network

network = IN[0]

key_index = network.key_index()

vertices = [network.vertex_coordinates(key) for key in network.vertices()]
points = [Point.ByCoordinates(x, y, z) for x, y, z in vertices]

OUT = points
# ----------------------------------------
Point = Output(vertexPositions)  # "Point[]"
