# Dynamo custom node CompasNetwork.leaf_vertices.dyf (Dynamo 1.3.0.875)
# category: Compas.Datastructures.Network
# returns the leaf vertices and indices of a compas network

CompasNetwork = Input()
leaf_vertices = Python(IN[0]=CompasNetwork)  # "CompasNetwork.leaf_vertices"
# ---------- leaf_vertices.python (24 lines) ----------
import sys

with open('C:/Temp/compas_path.txt', 'r') as f:
    compas_path = f.readline().strip()
    iron_path = f.readline().strip()

sys.path.insert(0, iron_path)
sys.path.insert(0, iron_path + 'DLLs')
sys.path.insert(0, iron_path + 'Lib')
sys.path.insert(0, compas_path)

import clr
clr.AddReference('ProtoGeometry')
from Autodesk.DesignScript.Geometry import *

import compas
from compas.datastructures.network import Network

network = IN[0]

vkeys = [k for k in network.vertex if network.is_vertex_leaf(k)]
vert = [network.get_vertex_attributes(k, ['x', 'y', 'z']) for k in network.vertex if network.is_vertex_leaf(k)]
points = [Point.ByCoordinates(v[0], v[1], v[2]) for v in vert]
OUT = [points, vkeys]
# ----------------------------------------
python_script = Python(IN[0]=leaf_vertices)
# ---------- python_script.python (8 lines) ----------
import clr
clr.AddReference('ProtoGeometry')
from Autodesk.DesignScript.Geometry import *
#The inputs to this node will be stored as a list in the IN variables.
dataEnteringNode = IN

#Assign your output to the OUT variable.
OUT = IN[0][0]
# ----------------------------------------
Points = Output(python_script)
python_script_2 = Python(IN[0]=leaf_vertices)
# ---------- python_script_2.python (8 lines) ----------
import clr
clr.AddReference('ProtoGeometry')
from Autodesk.DesignScript.Geometry import *
#The inputs to this node will be stored as a list in the IN variables.
dataEnteringNode = IN

#Assign your output to the OUT variable.
OUT = IN[0][1]
# ----------------------------------------
Indices = Output(python_script_2)
