# Dynamo graph example_mesh-subdivision.dyn (Dynamo 1.3.0.875)

integer_slider = IntegerSlider(6, range=4..8 step 2)
number_slider = DoubleSlider(5, range=1..10 step 1)
from_polyhedron = Custom[CompasMesh.from_polyhedron](number_of_faces=integer_slider, scale=number_slider)  # Create a compas mesh from a platonic solid.
integer_slider_2 = IntegerSlider(3, range=1..6 step 1)
subdivide_mesh_catmullclark = Custom[CompasMesh.subdivide_mesh_catmullclark](CompasMesh=from_polyhedron, k=integer_slider_2)  # Subdivide a compas mesh according to the catmull-clark scheme.
byCompasMesh = Custom[Mesh.ByCompasMesh](CompasMesh=subdivide_mesh_catmullclark)  # Make a dynamo mesh from a compas mesh
edges = Custom[CompasMesh.Edges](CompasMesh=subdivide_mesh_catmullclark)  # Return the edges of the compas mesh as Dynamo lines.
