# Dynamo graph example_network-smooth-centroid.dyn (Dynamo 1.3.0.875)

file_path = Filename("Z:\compas\core\data\open_edges.obj")
from_obj = Custom[CompasNetwork.from_obj](FilePath=file_path)  # Make a compas network from an OBJ file.
leaves = Python(IN[0]=from_obj)  # "CompasNetwork.Leaves"
# ---------- leaves.python (17 lines) ----------
import sys

sys.path.insert(0, 'C:\IronPython27')
sys.path.insert(0, 'C:\IronPython27\DLLs')
sys.path.insert(0, 'C:\IronPython27\Lib')

sys.path.insert(0, 'Z:\compas\core\src')

import clr
clr.AddReference('ProtoGeometry')
from Autodesk.DesignScript.Geometry import *

import compas

network = IN[0]

OUT = network.leaves()
# ----------------------------------------
integer_slider = IntegerSlider(8, range=0..100 step 1)
smooth_network_centroid = Custom[CompasNetwork.smooth_network_centroid](CompasNetwork=from_obj, fixed=leaves, kmax=integer_slider)  # Smooth the network by moving every vertex to the centroid of its neighbours.
edges = Custom[CompasNetwork.Edges](CompasNetwork=smooth_network_centroid)  # Return the edges of a compas network as a list of Dynamo lines.
vertexPositions = Custom[CompasNetwork.VertexPositions](CompasNetwork=smooth_network_centroid)  # Return the vertices of a network as a list of Dynamo points.
edges_2 = Custom[CompasNetwork.Edges](CompasNetwork=from_obj)
vertexPositions_2 = Custom[CompasNetwork.VertexPositions](CompasNetwork=from_obj)
