# Dynamo graph exmaple_network-shortest-path.dyn (Dynamo 1.3.0.875)

file_path = Filename("Z:\compas\core\data\grid_irregular.obj")
from_obj = Custom[CompasNetwork.from_obj](FilePath=file_path)  # Make a compas network from an OBJ file.
vertexKeys = Custom[CompasNetwork.VertexKeys](CompasNetwork=from_obj)  # Return a list of vertex keys.
watch = Watch(vertexKeys)
edges = Custom[CompasNetwork.Edges](CompasNetwork=from_obj)  # Return the edges of a compas network as a list of Dynamo lines.
vertexPositions = Custom[CompasNetwork.VertexPositions]()  # Return the vertices of a network as a list of Dynamo points.; unwired: CompasNetwork
network_dijkstra_path = Custom[CompasNetwork.network_dijkstra_path](CompasNetwork=from_obj)  # Compute the shortest path between two vertices of a compas network with weighted edges.
integer_slider = IntegerSlider(0, range=0..100 step 1)
highlightVertex = Custom[CompasNetwork.HighlightVertex](CompasNetwork=from_obj, index=integer_slider)  # Highlight a vertex of a compas network
