# Dynamo graph fd.dyn (Dynamo 1.3.0.875)

file_path = Filename("\\Mac\Home\Documents\compas\core\data\grid_irregular.obj")
from_obj = Python(IN[0]=file_path)  # "CompasNetwork.from_obj"
# ---------- from_obj.python (19 lines) ----------
import sys
with open('C:/Temp/compas_path.txt', 'r') as f:
    compas_path = f.readline().strip()
    iron_path = f.readline().strip()

sys.path.insert(0, iron_path)
sys.path.insert(0, iron_path+'DLLs')
sys.path.insert(0, iron_path+'Lib')
sys.path.insert(0, compas_path)

import clr
clr.AddReference('ProtoGeometry')
from Autodesk.DesignScript.Geometry import *
import compas
from compas.datastructures.network import Network

filepath = IN[0]
network = Network.from_obj(filepath)
OUT = network
# ----------------------------------------
code_block = CodeBlock { {"is_anchor", "px", "py", "pz"}; }
code_block_2 = CodeBlock { {true, 0.0, 0.0, 0.0}; }
update_default_vertex_attributes = Custom[CompasNetwork.update_default_vertex_attributes](CompasNetwork=from_obj, Names=code_block, Values=code_block_2)  # updates the default vertext attributes from a list of keys and a list of values
code_block_3 = CodeBlock { {"q"}; }
code_block_4 = CodeBlock { {1.0}; }
update_default_edge_Attributes = Custom[CompasNetwork.update_default_edge_Attributes](CompasNetwork=update_default_vertex_attributes, Names=code_block_3, Values=code_block_4)  # Updates the default edge attributes of a compas network from a list of keys and a list of values
watch = Watch(update_default_edge_Attributes)
leaf_vertices = Custom[CompasNetwork.leaf_vertices](CompasNetwork=update_default_edge_Attributes)  # returns the leaf vertices and indices of a compas network
code_block_5 = CodeBlock { "is_anchor"; }
boolean = BoolSelector(true)
update_vertex_attributes = Custom[CompasNetwork.update_vertex_attributes](CompasNetwork=update_default_edge_Attributes, Points=leaf_vertices.Points, name=code_block_5, values=boolean)  # Updates vertex attributes fort a given set of points
edges = Custom[CompasNetwork.Edges](CompasNetwork=update_vertex_attributes)  # Return the edges of a compas network as a list of Dynamo lines.
