# Dynamo graph testing_01.dyn (Dynamo 1.3.0.875)

file_path = Filename("meshes\saddle.obj")
compasNetworkFromObj = Compas.Dynamo.Datastructures.CompasNetwork.CompasNetworkFromObj(file_path)
integer_slider = IntegerSlider(50, range=0..100 step 1)
boolean = BoolSelector(true)
smooth = Compas.Dynamo.Datastructures.CompasNetwork.Smooth(compasNetworkFromObj, integer_slider, boolean)
integer_slider_2 = IntegerSlider(0, range=0..100 step 1)
animateNetwork = Compas.Dynamo.Datastructures.CompassNetworkAnimationViz.AnimateNetwork(smooth, integer_slider_2)
from_obj = Custom[CompasMesh.from_obj](FilePath=file_path)  # Construct a compas mesh from an OBJ file.
